# Grasshopper definition fractal_tree_01.gh (Grasshopper 1.0.4)

radius_to_length_proportion = Slider(11, range=0..100)
radius_to_length_proportion_2 = Slider(11, range=0..100)
radius_to_length_proportion_3 = Slider(20, range=0..100)
length_randomness = Slider(58, range=0..100)
angle_randomness = Slider(59, range=0..100)
length_randomness_2 = Slider(63, range=0..100)
length_randomness_3 = Slider(72, range=0..100)
construct_point = ConstructPoint(XCoordinate=0, YCoordinate=0, ZCoordinate=0)
angle_randomness_2 = Slider(49, range=0..100)
construct_point_2 = ConstructPoint(XCoordinate=0, YCoordinate=0, ZCoordinate=0)
angle_randomness_3 = Slider(49, range=0..100)
length_randomness_4 = Slider(0, range=0..100)
construct_point_3 = ConstructPoint(XCoordinate=0, YCoordinate=0, ZCoordinate=0)
angle_randomness_4 = Slider(0, range=0..100)
construct_point_4 = ConstructPoint(XCoordinate=0, YCoordinate=0, ZCoordinate=0)
length_change = Slider(0.7, range=-0.1..0.9)
starting_length = Slider(241, range=50..1000)
depth = Slider(6, range=1..15)
max_angle = Slider(36, range=5..90)
length_change_2 = Slider(0.7, range=-0.1..0.9)
length_change_3 = Slider(0.7, range=-0.1..0.9)
depth_2 = Slider(5, range=1..15)
max_angle_2 = Slider(44, range=5..90)
starting_length_2 = Slider(243, range=50..1000)
depth_3 = Slider(5, range=1..15)
starting_length_3 = Slider(243, range=50..1000)
max_angle_3 = Slider(54, range=0..180)
max_angle_4 = Slider(44, range=5..90)
max_angle_5 = Slider(42, range=0..180)
length_change_4 = Slider(0.8, range=-0.1..0.9)
starting_length_4 = Slider(570, range=50..1000)
max_angle_6 = Slider(51, range=5..90)
max_angle_7 = Slider(36, range=0..180)
depth_4 = Slider(6, range=1..15)
starting_ngon = Slider(8, range=1..15)
starting_ngon_2 = Slider(7, range=1..15)
ghpython_script = GhPythonScript(
    anchorp=construct_point_4,
    depth=depth,
    angle=max_angle,
    length=starting_length,
    lvariation=length_change,
    aran=angle_randomness,
    lran=length_randomness)  # -> treelin, treept; inputs anchorp: Point3d
# ---------- ghpython_script: Python ----------
#importing grasshopper python modules
import rhinoscriptsyntax as rs
import Rhino.Geometry as rg

#importing generic modules
from math import cos
from math import sin
from math import radians
import random

#Inputs
#anchorp - point3D, anchor point
#depth - integer, recursion cnt
#angle - float, split base angle
#length - float, first branch length
#lvariation - float, length change with each branch
#aran - float, % of randomness in relation to base angle
#lran - float, % of randomness in relation to base length

#getting starting point from anchorpoint
x1 = anchorp.X
y1 = anchorp.Y
z1 = anchorp.Z

#setting base variables
x2 = x1
y2 = y1
z2 = z1

#base angle
anglerec = 0

#list of lines that form the tree, this is the output variable 
treelin = []


#recursive function
def fractal(depth , x2, y2, z2, length, anglerec, angle, lvariation, aran, lran):
    
    #test if depth>0
    if depth:
        
        #defining random angle variation and length variation
        arn = random.uniform(-angle/100*aran, angle/100*aran)
        lrn = random.uniform(-length/100*lran, length/100*lran)
        
        #defining points
        x1 = x2
        y1 = y2
        z1 = z2 
        z2 = z1 + (length+lrn)*cos(radians(anglerec))
        y2 = y1 + (length+lrn)*sin(radians(anglerec))
        
        #changing branch length dependant on branch depth
        length = length*lvariation
        
        #building points
        stpoint = [x1, y1, z1]
        endpoint = [x2, y2, z2]
        
        #building line between points
        treelin.append(rs.AddLine(stpoint, endpoint))
        
        #calling function with different angle parameter for branch splitting
        fractal(depth - 1 , x2, y2, z2, length, (anglerec+angle+arn), angle, lvariation, aran, lran)
        fractal(depth - 1 , x2, y2, z2, length, (anglerec-angle+arn), angle, lvariation, aran, lran)
        
#first recursive function call
fractal(depth, x2, y2, z2, length, anglerec, angle, lvariation, aran, lran)
# ---------- end ghpython_script ----------
ghpython_script_2 = GhPythonScript(
    anchorp=construct_point,
    depth=depth_2,
    angle=max_angle_2,
    angleh=max_angle_3,
    length=starting_length_2,
    lvariation=length_change_2,
    aran=angle_randomness_2,
    lran=length_randomness_2,
    radtolen=radius_to_length_proportion)  # -> out, flatlinep; inputs anchorp: Point3d
# ---------- ghpython_script_2: Python ----------
#importing grasshopper python modules
import rhinoscriptsyntax as rs
import Rhino.Geometry as rg
import ghpythonlib.parallel as ghp
import ghpythonlib.components as ghc
import Rhino as rc


#importing generic modules
from math import cos
from math import sin
from math import radians
import random

#Inputs
#anchorp - point3D, anchor point
#depth - integer, recursion cnt
#angle - float, split base angle
#length - float, first branch length
#lvariation - float, length change with each branch
#aran - float, % of randomness in relation to base angle
#lran - float, % of randomness in relation to base length
#radtolen - proportion between starting length branch depth and branch radius

#getting starting point from anchorpoint
x1 = anchorp.X
y1 = anchorp.Y
z1 = anchorp.Z

#setting base variables
x2 = x1
y2 = y1
z2 = z1

#base angle
anglerec = 0
anglerech = 0

#list of lines that form the tree, this is the output variable 
treelin = {}

anglest = []

#recursive function
def fractal(depth, x2, y2, z2, length, anglerec, angle, lvariation, aran, lran, anglerech, angleh):
    
    #test if depth>0
    if depth:
        
        #defining random angle variation and length variation
        arn = random.uniform(-angle/100*aran, angle/100*aran)
        lrn = random.uniform(-length/100*lran, length/100*lran)
        
        #defining horizontal rotation angles
        ahor = random.sample(range(0,360), 4)
        
        #removing numbers within tolerance
        ahr = rs.CullDuplicateNumbers(ahor, angleh)
        
        #in a 360 fashion
        if ahr[0]+360-angleh<ahr[-1]:
            del ahr[0]
        
        #defining points
        x1 = x2
        y1 = y2
        z1 = z2 
        x2 = x1 - (length+lrn)*sin(radians(anglerec))*sin(radians(anglerech))
        y2 = y1 + (length+lrn)*sin(radians(anglerec))*cos(radians(anglerech))
        z2 = z1 + (length+lrn)*cos(radians(anglerec))
        
        #changing branch length dependant on branch depth
        length = length*lvariation
        
        #building points
        stpoint = rg.Point3d(x1, y1, z1)
        endpoint = rg.Point3d(x2, y2, z2)
        
        #building line between points
        linegeo = rg.Line(stpoint, endpoint)
        
        #building a dict of lines with depth as key, and corresponding lines as values
        if depth not in treelin.keys():
            treelin[depth] = [linegeo]
        else: 
            treelin[depth].append(linegeo)
        
        #calling function with different angle parameter for branch splitting
        #calling as many branches as spread within tolerance
        if len(ahr) > 0:
            fractal(depth - 1 , x2, y2, z2, length, (anglerec+angle+arn), angle, lvariation, aran, lran, ahr[0], angleh)
        if len(ahr) > 1:
            fractal(depth - 1 , x2, y2, z2, length, (anglerec-angle+arn), angle, lvariation, aran, lran, ahr[1], angleh)
        if len(ahr) > 2:
            fractal(depth - 1 , x2, y2, z2, length, (anglerec+angle+arn), angle, lvariation, aran, lran, ahr[2], angleh)
        if len(ahr) > 3:
            fractal(depth - 1 , x2, y2, z2, length, (anglerec-angle+arn), angle, lvariation, aran, lran, ahr[3], angleh)
        
#first recursive function call
fractal(depth, x2, y2, z2, length, anglerec, angle, lvariation, aran, lran, anglerech, angleh)

#sort dict of branch lines
treelinsorted = {}
branch = depth

for key in treelin.keys():
    treelinsorted[branch] = treelin[key]
    branch -= 1

#maybe implement intersect tests between branches
def removeintersections():
    pass
    #events = Rhino.Geometry.Intersect.Intersection.CurveCurve(curveA, curveB, intersection_tolerance, overlap_tolerance)

#function that create sphere capped pipes on lines
def pipes(args):
    crv, rad = args
    return ghc.Pipe(crv, rad, 1)

#paralle compute execution of pipes function
linep = []

for kk in treelinsorted.keys():
    args = [[treelinsorted[kk], (length*(lvariation**kk))/radtolen]]
    linep.append(ghp.run(pipes, args, True))

#flatten a list of pipes for output
flatlinep = [y for x in linep for y in x]
# ---------- end ghpython_script_2 ----------
ghpython_script_3 = GhPythonScript(
    anchorp=construct_point_2,
    depth=depth_3,
    angle=max_angle_4,
    angleh=max_angle_5,
    length=starting_length_3,
    lvariation=length_change_3,
    aran=angle_randomness_3,
    lran=length_randomness_3,
    radtolen=radius_to_length_proportion_2,
    mngon=starting_ngon)  # -> out, flatlinep, stpnt, endpnt, vect, pln, pgons, joined; inputs anchorp: Point3d
# ---------- ghpython_script_3: Python ----------
#importing grasshopper python modules
import rhinoscriptsyntax as rs
import Rhino.Geometry as rg
import ghpythonlib.parallel as ghp
import ghpythonlib.components as ghc
import Rhino as rc


#importing generic modules
from math import cos
from math import sin
from math import radians
import random

#Inputs
#anchorp - point3D, anchor point
#depth - integer, recursion cnt
#angle - float, split base angle
#length - float, first branch length
#lvariation - float, length change with each branch
#aran - float, % of randomness in relation to base angle
#lran - float, % of randomness in relation to base length
#radtolen - proportion between starting length branch depth and branch radius

#getting starting point from anchorpoint
x1 = anchorp.X
y1 = anchorp.Y
z1 = anchorp.Z

#setting base variables
x2 = x1
y2 = y1
z2 = z1

#base angle
anglerec = 0
anglerech = 0

#list of lines that form the tree, this is the output variable 
treelin = {}

anglest = []

#recursive function
def fractal(depth, x2, y2, z2, length, anglerec, angle, lvariation, aran, lran, anglerech, angleh):
    
    #test if depth>0
    if depth:
        
        #defining random angle variation and length variation
        arn = random.uniform(-angle/100*aran, angle/100*aran)
        lrn = random.uniform(-length/100*lran, length/100*lran)
        
        #defining horizontal rotation angles
        ahor = random.sample(range(0,360), 4)
        
        #removing numbers within tolerance
        ahr = rs.CullDuplicateNumbers(ahor, angleh)
        
        #in a 360 fashion
        if ahr[0]+360-angleh<ahr[-1]:
            del ahr[0]
        
        #defining points
        x1 = x2
        y1 = y2
        z1 = z2 
        x2 = x1 - (length+lrn)*sin(radians(anglerec))*sin(radians(anglerech))
        y2 = y1 + (length+lrn)*sin(radians(anglerec))*cos(radians(anglerech))
        z2 = z1 + (length+lrn)*cos(radians(anglerec))
        
        #changing branch length dependant on branch depth
        length = length*lvariation
        
        #building points
        stpoint = rg.Point3d(x1, y1, z1)
        endpoint = rg.Point3d(x2, y2, z2)
        
        #building line between points
        linegeo = rg.Line(stpoint, endpoint)
        
        #building a dict of lines with depth as key, and corresponding lines as values
        if depth not in treelin.keys():
            treelin[depth] = [linegeo]
        else: 
            treelin[depth].append(linegeo)
        
        #calling function with different angle parameter for branch splitting
        #calling as many branches as spread within tolerance
        if len(ahr) > 0:
            fractal(depth - 1 , x2, y2, z2, length, (anglerec+angle+arn), angle, lvariation, aran, lran, ahr[0], angleh)
        if len(ahr) > 1:
            fractal(depth - 1 , x2, y2, z2, length, (anglerec-angle+arn), angle, lvariation, aran, lran, ahr[1], angleh)
        if len(ahr) > 2:
            fractal(depth - 1 , x2, y2, z2, length, (anglerec+angle+arn), angle, lvariation, aran, lran, ahr[2], angleh)
        if len(ahr) > 3:
            fractal(depth - 1 , x2, y2, z2, length, (anglerec-angle+arn), angle, lvariation, aran, lran, ahr[3], angleh)
        
#first recursive function call
fractal(depth, x2, y2, z2, length, anglerec, angle, lvariation, aran, lran, anglerech, angleh)

#sort dict of branch lines
treelinsorted = {}
branch = depth

for key in treelin.keys():
    treelinsorted[branch] = treelin[key]
    branch -= 1

#maybe implement intersect tests between branches
def removeintersections():
    pass
    #events = Rhino.Geometry.Intersect.Intersection.CurveCurve(curveA, curveB, intersection_tolerance, overlap_tolerance)

#output list
pgons = []

#create ngon branch depth dependant
def ngons(args):
    nn, length, lvariation, kk, radtolen, mngon, depth = args
    stpnt = ghc.EndPoints(nn)[0] #returns list of two points, start and end
    endpnt = ghc.EndPoints(nn)[1]
    vect = ghc.Vector2Pt(stpnt, endpnt, False)[0] #returns list with vector and vector length
    pln = ghc.PlaneNormal(stpnt, vect) #returns a plane perp to a vector
    radius = length*(lvariation**kk)/radtolen
        
    #reduce details with each branch, but not less than 3
    if mngon-kk+1 <= 3:
        splits = 3
    else:
        splits = mngon-kk+1
    
    pgn = ghc.Polygon(pln, radius, splits, 0)[0] #returns a polygon and its perimeter
    
    if kk == depth and splits == 3:
        geo = ghc.ExtrudePoint(pgn, endpnt) #if last branch than make a pyramid
    else:
        geo = ghc.Extrude(pgn, vect) #extrudes the polygon along vector
    
    return ghc.CapHoles(geo) #caps ends on the extruded brep

#iterate over branches and run ngons func
for kk in treelinsorted.keys():
    for nn in treelinsorted[kk]:
        args = [nn, length, lvariation, kk, radtolen, mngon, depth]
        pgons.append(ngons(args))

def joiner(breps):
    return ghc.SolidUnion(breps)

#joined = joiner(pgons)
# ---------- end ghpython_script_3 ----------
ghpython_script_4 = GhPythonScript(
    anchorp=construct_point_3,
    depth=depth_4,
    angle=max_angle_6,
    angleh=max_angle_7,
    length=starting_length_4,
    lvariation=length_change_4,
    aran=angle_randomness_4,
    lran=length_randomness_4,
    radtolen=radius_to_length_proportion_3,
    mngon=starting_ngon_2)  # -> out, flatlinep, stpnt, endpnt, vect, pln, treelinout, pgons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; inputs anchorp: Point3d
# ---------- ghpython_script_4: Python ----------
#importing grasshopper python modules
import rhinoscriptsyntax as rs
import Rhino.Geometry as rg
import ghpythonlib.parallel as ghp
import ghpythonlib.components as ghc
import Rhino as rc


#importing generic modules
from math import cos
from math import sin
from math import radians
import random

#Inputs
#anchorp - point3D, anchor point
#depth - integer, recursion cnt
#angle - float, split base angle
#length - float, first branch length
#lvariation - float, length change with each branch
#aran - float, % of randomness in relation to base angle
#lran - float, % of randomness in relation to base length
#radtolen - proportion between starting length branch depth and branch radius

#getting starting point from anchorpoint
x1 = anchorp.X
y1 = anchorp.Y
z1 = anchorp.Z

#setting base variables
x2 = x3 = x1
y2 = y3 = y1
z2 = z1 
z3 = length

#base angle
anglerec = 0
anglerech = 0

#list of lines that form the tree, this is the output variable 
treelin = {}

anglest = []

#recursive function
def fractal(depth, x2, y2, z2, x3, y3, z3, length, anglerec, angle, lvariation, aran, lran, anglerech, angleh):
    
    #test if depth>0
    if depth:
        
        #defining random angle variation and length variation
        arn = random.uniform(-angle/100*aran, angle/100*aran)
        lrn = random.uniform(-length/100*lran, length/100*lran)
        
        #defining horizontal rotation angles
        ahor = random.sample(range(0,360), 4)
        
        #removing numbers within tolerance
        ahr = rs.CullDuplicateNumbers(ahor, angleh)
        
        #in a 360 fashion
        if ahr[0]+360-angleh<ahr[-1]:
            del ahr[0]
            
        random.shuffle(ahr)
        
        #previous branch vector
        
        vecst = rg.Point3d(x2, y2, z2)
        vecend = rg.Point3d(x3, y3, z3)
        
        movevec = ghc.Vector2Pt(vecst, vecend, True)[0]
        
        #perpendicular vector rotation plane
        
        rotplane3 = ghc.PlaneNormal(vecend, movevec)[0]
        plns = ghc.DeconstructPlane(rotplane3) #origin, x, y, z
        rotplane = ghc.ConstructPlane(plns[0], plns[3], plns[2])
        
        vecperp = ghc.Rotate(movevec, radians(90), rotplane)[0]
        
        
        #defining points
        x1 = x2
        y1 = y2
        z1 = z2
        x2 = x3
        y2 = y3
        z2 = z3
        x3 = x3
        leny = (length+lrn)*sin(radians(anglerec))
        lenz = (length+lrn)*cos(radians(anglerec))
        ampy = ghc.Amplitude(vecperp, leny)
        ampz = ghc.Amplitude(movevec, lenz)
        #y3 = ghc.Move(y2, ampy)[0]
        #z3 = ghc.Move(z2, ampz)[0]
        #ghc.Amplitude(vector, length)
        #ghc.Move(geometry, vector)[0]
        
        #y3 = y2 + (length+lrn)*sin(radians(anglerec))
        #z3 = z2 + (length+lrn)*cos(radians(anglerec))
        
        
        #changing branch length dependant on branch depth
        length = length*lvariation
        
        #building points
        stpoint = vecend 
        #endpoint = rg.Point3d(x3, y3, z3)
        endpoint1 = ghc.Move(stpoint, ampz)[0]
        endpoint = ghc.Move(endpoint1, ampy)[0]
        
        #endpoint = ghc.PointOriented(rotplane, 0, y3, z3)
        
        #rotating point in a cone fashion
        
        rotpoint = ghc.Rotate3D(endpoint, anglerech, vecend, movevec)[0]
        
        #building line between points
        linegeo = rg.Line(stpoint, rotpoint)
        
        #getting xyz from rotated point
        
        x3 = rg.Point3d(rotpoint)[0]
        y3 = rg.Point3d(rotpoint)[1]
        z3 = rg.Point3d(rotpoint)[2]
        
        x2 = rg.Point3d(vecend)[0]
        y2 = rg.Point3d(vecend)[1]
        z2 = rg.Point3d(vecend)[2]
        
        #building a dict of lines with depth as key, and corresponding lines as values
        if depth not in treelin.keys():
            treelin[depth] = [linegeo]
        else: 
            treelin[depth].append(linegeo)
        
        #calling function with different angle parameter for branch splitting
        #calling as many branches as spread within tolerance
        for aa in ahr:
            fractal(depth - 1 , x2, y2, z2, x3, y3, z3, length, angle, angle, lvariation, aran, lran, aa, angleh)
        

        
#first recursive function call
fractal(depth, x2, y2, z2, x3, y3, z3, length, anglerec, angle, lvariation, aran, lran, anglerech, angleh)

#sort dict of branch lines
treelinsorted = {}
branch = depth

for key in treelin.keys():
    treelinsorted[branch] = treelin[key]
    branch -= 1

#maybe implement intersect tests between branches
def removeintersections():
    pass
    #events = Rhino.Geometry.Intersect.Intersection.CurveCurve(curveA, curveB, intersection_tolerance, overlap_tolerance)

#output list
pgons = []

#create ngon branch depth dependant
def ngons(args):
    nn, length, lvariation, kk, radtolen, mngon, depth = args
    stpnt = ghc.EndPoints(nn)[0] #returns list of two points, start and end
    endpnt = ghc.EndPoints(nn)[1]
    vect = ghc.Vector2Pt(stpnt, endpnt, False)[0] #returns list with vector and vector length
    pln = ghc.PlaneNormal(stpnt, vect) #returns a plane perp to a vector
    radius = length*(lvariation**kk)/radtolen
        
    #reduce details with each branch, but not less than 3
    if mngon-kk+1 <= 3:
        splits = 3
    else:
        splits = mngon-kk+1
    
    pgn = ghc.Polygon(pln, radius, splits, 0)[0] #returns a polygon and its perimeter
    
    if kk == depth and splits == 3:
        geo = ghc.ExtrudePoint(pgn, endpnt) #if last branch than make a pyramid
    else:
        geo = ghc.Extrude(pgn, vect) #extrudes the polygon along vector
    
    return ghc.CapHoles(geo) #caps ends on the extruded brep

#iterate over branches and run ngons func
for kk in treelinsorted.keys():
    for nn in treelinsorted[kk]:
        args = [nn, length, lvariation, kk, radtolen, mngon, depth]
        pgons.append(ngons(args))

def joiner(breps):
    return ghc.SolidUnion(breps)

#joined = joiner(pgons)

treelinout = treelin[1]
treelinout += treelin[2]
# ---------- end ghpython_script_4 ----------
curve = Curve(ghpython_script_4.treelinout)
vector_2pt = Vector2Pt(Unitize=False)  # -> Vector, Length
rotate = Rotate(Angle=1.570796327, Plane=PlaneXY(0, 0, 0))  # -> Geometry, Transform
rotate_3d = Rotate3D(Angle=1.570796327, Center=Point(0, 0, 0), Axis=Vector(0, 0, 1))  # -> Geometry, Transform
point_oriented = PointOriented(BasePlane=PlaneXY(0, 0, 0), UComponent=0, VComponent=0, WComponent=0)
panel = Panel(ghpython_script_3.out)
number_slider = Slider(500, range=0..1000)
number_slider_2 = Slider(282, range=0..1000)
vector_xyz = VectorXYZ(XComponent=Slider(0, range=0..100), YComponent=Slider(1, range=0..1), ZComponent=Slider(1, range=0..1))  # -> Vector, Length
construct_point_5 = ConstructPoint(XCoordinate=number_slider, YCoordinate=0, ZCoordinate=0)
construct_point_6 = ConstructPoint(XCoordinate=number_slider, YCoordinate=0, ZCoordinate=Slider(200, range=0..1000))
construct_point_7 = ConstructPoint(XCoordinate=number_slider, YCoordinate=Slider(100, range=0..100), ZCoordinate=number_slider_2)
construct_point_8 = ConstructPoint(XCoordinate=number_slider, YCoordinate=Slider(150, range=0..1000), ZCoordinate=number_slider_2)
number_slider_3 = Slider(10, range=0..10)
construct_point_9 = ConstructPoint(XCoordinate=number_slider_3, YCoordinate=number_slider_3, ZCoordinate=number_slider_3)
range = Range(Domain=Slider(360, range=0..360), Steps=10)
# rotate3d
vector_2pt_2 = Vector2Pt(PointA=construct_point_5, PointB=construct_point_6, Unitize=False)  # -> Vector, Length
line = Line(StartPoint=construct_point_5, EndPoint=construct_point_6)
extend_curve = ExtendCurve(Type=0)
rotate_3d_2 = Rotate3D(Geometry=construct_point_7, Angle=degrees(range), Center=construct_point_6, Axis=line)  # -> Geometry, Transform
list_item = ListItem(List=rotate_3d_2.Geometry, Index=Slider(5, range=0..10), Wrap=True)
vector_2pt_3 = Vector2Pt(PointA=construct_point_6, PointB=list_item, Unitize=False)  # -> Vector, Length
line_sdl = LineSDL(Start=construct_point_5, Direction=vector_2pt_3.Vector, Length=Slider(300, range=0..1000))
plane_normal = PlaneNormal(Origin=construct_point_5, ZAxis=line_sdl)
deconstruct_plane = DeconstructPlane(Plane=plane_normal)  # -> Origin, XAxis, YAxis, ZAxis
construct_plane = ConstructPlane(Origin=vector_2pt_3.Vector, XAxis=deconstruct_plane.ZAxis, YAxis=deconstruct_plane.YAxis)
plane_3pt = Plane3Pt(PointA=construct_point_6, PointB=list_item, PointC=construct_point_9)
line_2 = Line(StartPoint=construct_point_6, EndPoint=list_item)
vector = Vector(line)
vector_display_ex = VectorDisplayEx(Point=[construct_point_5, construct_point_6], Vector=vector_2pt_2.Vector, Colour=RGB(0, 0, 0), Width=2)
line_pt = LinePt(Line=line_2, Point=construct_point_5)
move = Move(Geometry=list_item, Motion=line)  # -> Geometry, Transform
plane_normal_2 = PlaneNormal(Origin=list_item, ZAxis=line_2)
move_2 = Move(Geometry=list_item, Motion=vector_2pt_3.Vector)  # -> Geometry, Transform
rotate_2 = Rotate(Geometry=[vector_2pt_3.Vector, line_2], Angle=degrees(Slider(90, range=0..100)), Plane=line_pt)  # -> Geometry, Transform
vector_display_ex_2 = VectorDisplayEx(Point=[construct_point_6, list_item], Vector=vector_2pt_3.Vector, Colour=RGB(0, 0, 0), Width=2)
rotate_3d_3 = Rotate3D(Geometry=move_2.Geometry, Angle=degrees(range), Center=list_item, Axis=line_2)  # -> Geometry, Transform
vector_display_ex_3 = VectorDisplayEx(Point=list_item, Vector=rotate_2.Geometry, Colour=RGB(0, 0, 0), Width=2)
move_3 = Move(Motion=Vector(0, 0, 10))  # -> Geometry, Transform
